# Grasshopper definition exporter.gh (Grasshopper 1.0.7)
# plug-ins: PlanGraph

elb = EdgeLabels({"h-8", "h-7", "h-9", "h-10", "h-11", "h-12", "h-1", "h-2", "h-3", "h-4", "h-5", "h-6"}, selected=["h-8", "h-7", "h-9", "h-10", "h-11", "h-12", "h-1", "h-2", "h-3", "h-4", "h-5", "h-6"])

# ---- group: graph
geo = Geometry(<curve referenced from the Rhino model>)
geo_2 = Geometry(<curve referenced from the Rhino model>)
geo_3 = Geometry(<curve referenced from the Rhino model>)
geo_4 = Geometry(<curve referenced from the Rhino model>)
geo_5 = Geometry(<curve referenced from the Rhino model>)
geo_6 = Geometry(<curve referenced from the Rhino model>)
geo_7 = Geometry(<curve referenced from the Rhino model>)
area = Area(Geometry=geo)  # -> Area, Centroid
area_2 = Area(Geometry=geo_3)  # -> Area, Centroid
area_3 = Area(Geometry=geo_2)  # -> Area, Centroid
area_4 = Area(Geometry=geo_5)  # -> Area, Centroid
area_5 = Area(Geometry=geo_4)  # -> Area, Centroid
area_6 = Area(Geometry=geo_7)  # -> Area, Centroid
area_7 = Area(Geometry=geo_6)  # -> Area, Centroid
# building the planar graph
node = ConstructNode(Name="0", Label="hall", Area=area.Area, Center=area.Centroid)
node_2 = ConstructNode(Name="1", Label="Flat 1", Area=area_2.Area, Center=area_2.Centroid)
node_3 = ConstructNode(Name="2", Label="Flat 2", Area=area_3.Area, Center=area_3.Centroid)
node_4 = ConstructNode(Name="3", Label="Flat 3", Area=area_4.Area, Center=area_4.Centroid)
node_5 = ConstructNode(Name="4", Label="Flat 4", Area=area_5.Area, Center=area_5.Centroid)
node_6 = ConstructNode(Name="6", Label="Flat 6", Area=area_6.Area, Center=area_6.Centroid)
node_7 = ConstructNode(Name="5", Label="Flat 5", Area=area_7.Area, Center=area_7.Centroid)
edge = ConstructEdge(Node1=node, Node2=node_2, Label="h-1")
edge_2 = ConstructEdge(Node1=node, Node2=node_3, Label="h-2")
edge_3 = ConstructEdge(Node1=node, Node2=node_4, Label="h-3")
edge_4 = ConstructEdge(Node1=node, Node2=node_5, Label="h-4")
edge_5 = ConstructEdge(Node1=node, Node2=node_6, Label="h-6")
edge_6 = ConstructEdge(Node1=node, Node2=node_7, Label="h-5")
geo_8 = Geometry(<curve referenced from the Rhino model>)
geo_9 = Geometry(<curve referenced from the Rhino model>)
geo_10 = Geometry(<curve referenced from the Rhino model>)
geo_11 = Geometry(<curve referenced from the Rhino model>)
geo_12 = Geometry(<curve referenced from the Rhino model>)
geo_13 = Geometry(<curve referenced from the Rhino model>)
area_8 = Area(Geometry=geo_9)  # -> Area, Centroid
area_9 = Area(Geometry=geo_8)  # -> Area, Centroid
area_10 = Area(Geometry=geo_11)  # -> Area, Centroid
area_11 = Area(Geometry=geo_10)  # -> Area, Centroid
area_12 = Area(Geometry=geo_13)  # -> Area, Centroid
area_13 = Area(Geometry=geo_12)  # -> Area, Centroid
node_8 = ConstructNode(Name="7", Label="Flat 7", Area=area_8.Area, Center=area_8.Centroid)
node_9 = ConstructNode(Name="8", Label="Flat 8", Area=area_9.Area, Center=area_9.Centroid)
node_10 = ConstructNode(Name="9", Label="Flat 9", Area=area_10.Area, Center=area_10.Centroid)
node_11 = ConstructNode(Name="10", Label="Flat 10", Area=area_11.Area, Center=area_11.Centroid)
node_12 = ConstructNode(Name="12", Label="Flat 12", Area=area_12.Area, Center=area_12.Centroid)
node_13 = ConstructNode(Name="11", Label="Flat 11", Area=area_13.Area, Center=area_13.Centroid)
edge_7 = ConstructEdge(Node1=node, Node2=node_8, Label="h-7")
edge_8 = ConstructEdge(Node1=node, Node2=node_9, Label="h-8")
edge_9 = ConstructEdge(Node1=node, Node2=node_10, Label="h-9")
edge_10 = ConstructEdge(Node1=node, Node2=node_11, Label="h-10")
edge_11 = ConstructEdge(Node1=node, Node2=node_12, Label="h-12")
edge_12 = ConstructEdge(Node1=node, Node2=node_13, Label="h-11")
ns = Nodes(port=[node_2, node_3, node_4, node_5, node_7, node_6, node_8, node_9, node_10, node_11, node_13, node_12, node])
es = Edges(port=[edge_8, edge_7, edge_9, edge_10, edge_12, edge_11, edge, edge_2, edge_3, edge_4, edge_6, edge_5])
graph = ConstructGraph(Nodes=ns, Edges=es)
drawpg = DrawPlanGraph(PlanGraph=graph, EdgeLabelsToConsider=elb)
nlb = WriteRoomLabels(PlanGraph=graph, TextHeight=Slider(1, range=0..10))

# ----
elb_2 = EdgeLabels({"h-8", "h-7", "h-9", "h-10", "h-11", "h-12", "h-1", "h-2", "h-3", "h-4", "h-5", "h-6"}, selected=["h-8", "h-7", "h-9", "h-10", "h-11", "h-12", "h-1", "h-2", "h-3", "h-4", "h-5", "h-6"])
mat = GraphMatrices(PlanGraph=graph, EdgeLabels=elb_2)  # -> AdjacencyMatrix, NodeInfo, EdgeInfo
dens = Density(PlanGraph=graph)
panel = Panel(mat.AdjacencyMatrix)
# graph analysis
matrix = DisplayMatrix(mat.AdjacencyMatrix)
panel_2 = Panel(mat.NodeInfo)
# data to be streamed from this panel into "stream.txt" and formatted into csv usinfgthe py script (outside of GH)
panel_3 = Panel(dens)
panel_4 = Panel(mat.EdgeInfo)

# ---- group: it does not export in the desired format
path = FilePath("C:\Users\silvi\Desktop\nexus\output.csv")
python = GhPythonScript(datastream=panel_4, path=path)  # -> flatten(out); disabled
# ---------- python: Python ----------
import csv
#Assuming 'data' is your dataset with columns ID, Label, Source, and Target
data = datastream

#Define CSV file path
csv_file_path = path

#Open CSV file for writing using io module
with open(csv_file_path, 'w') as csv_file:
    # Write header row
    csv_file.write(','.join(['ID', 'Label', 'Source', 'Target']) + '\n')

    # Loop through the data and write each row to the CSV file
    for row_tuple in data:
        row_str = ','.join([''.join(str(element)) for element in row_tuple])
        print("Current row:", row_str)  # Print the row contents for debugging
        csv_file.write(row_str + '\n')

print('Data exported to {csv_file_path}')
# ---------- end python ----------
panel_5 = Panel(python)
