# Grasshopper definition planar_graph_exporter.gh (Grasshopper 1.0.7)
# plug-ins: PlanGraph, jSwan

# ---- group: graph
geo = Geometry(<curve referenced from the Rhino model>)
geo_2 = Geometry(<curve referenced from the Rhino model>)
geo_3 = Geometry(<curve referenced from the Rhino model>)
geo_4 = Geometry(<curve referenced from the Rhino model>)
geo_5 = Geometry(<curve referenced from the Rhino model>)
geo_6 = Geometry(<curve referenced from the Rhino model>)
area = Area(Geometry=geo_2)  # -> Area, Centroid
area_2 = Area(Geometry=geo)  # -> Area, Centroid
area_3 = Area(Geometry=geo_3)  # -> Area, Centroid
area_4 = Area(Geometry=geo_4)  # -> Area, Centroid
area_5 = Area(Geometry=geo_5)  # -> Area, Centroid
area_6 = Area(Geometry=geo_6)  # -> Area, Centroid
node = ConstructNode(Name="1", Label="room 1", Area=area_2.Area, Center=area_2.Centroid)
node_2 = ConstructNode(Name="2", Label="room 2", Area=area.Area, Center=area.Centroid)
node_3 = ConstructNode(Name="3", Label="room 3", Area=area_3.Area, Center=area_3.Centroid)
node_4 = ConstructNode(Name="4", Label="room 4", Area=area_4.Area, Center=area_4.Centroid)
node_5 = ConstructNode(Name="5", Label="room 5", Area=area_5.Area, Center=area_5.Centroid)
node_6 = ConstructNode(Name="6", Label="room 6", Area=area_6.Area, Center=area_6.Centroid)
ns = Nodes(port=[node, node_2, node_3, node_4, node_5, node_6])
edge = ConstructEdge(Node1=node_3, Node2=node_5, Label="link35")
edge_2 = ConstructEdge(Node1=node, Node2=node_5, Label="1-5")
edge_3 = ConstructEdge(Node1=node_2, Node2=node_5, Label="2-5")
edge_4 = ConstructEdge(Node1=node_4, Node2=node_6, Label="4-6")
edge_5 = ConstructEdge(Node1=node_3, Node2=node_6, Label="3-6")
es = Edges(port=[edge, edge_3, edge_2, edge_5, edge_4])
graph = ConstructGraph(Nodes=ns, Edges=es)
nlb = WriteRoomLabels(PlanGraph=graph, TextHeight=2)
elb = EdgeLabels({"3-5", "2-5", "1-5", "3-6", "4-6"}, selected=["3-5", "2-5", "1-5", "3-6", "4-6"])
elb_2 = EdgeLabels({"3-5", "2-5", "1-5", "3-6", "4-6"}, selected=["3-5", "2-5", "1-5", "3-6", "4-6"])
drawpg = DrawPlanGraph(PlanGraph=graph, EdgeLabelsToConsider=elb_2)
mat = GraphMatrices(PlanGraph=graph, EdgeLabels=elb)  # -> AdjacencyMatrix, NodeInfo, EdgeInfo

# ----
adj_matrix = Data(mat.AdjacencyMatrix)
panel = Panel(adj_matrix)

# ---- group: working exporter matrix-csv
python = GhPythonScript(adj_matrix=adj_matrix)  # -> out, a
# ---------- python: Python ----------
import csv
import io

# Assume matrix is a 2D list (matrix)
matrix = adj_matrix

# Define CSV file path
csv_file_path = 'C:/Users/silvi/Downloads/JSON exporter test/output.csv'

# Open CSV file for writing using io module
with io.open(csv_file_path, 'w', newline='', encoding='utf-8') as csv_file:
    csv_writer = csv.writer(csv_file)

    # Write header row
    header = ["ID", "Label", "IsOutsideWorld", "Area", "Name", "X", "Y", "Z"]
    csv_writer.writerow(header)

    # Loop through the matrix and write each row to the CSV file
    for row in matrix:
        csv_writer.writerow(row)

print('Data exported to {csv_file_path}')
# ---------- end python ----------
panel_2 = Panel(python.out)

# ---- group: split list into keys and values
panel_3 = Panel(mat.EdgeInfo)
python_2 = GhPythonScript()  # -> out, a; inputs data: list; disabled
# ---------- python_2: Python ----------
# Your dataset
dataset = data

# Split the dataset into lines
lines = dataset.strip().split('\n')

# Extract keys from the first line
keys = lines[0].split(',')

# Extract values from the remaining lines
values = [line.split(',') for line in lines[1:]]

# Display keys and values
print("Keys:", keys)
print("Values:", values)
# ---------- end python_2 ----------
split = SplitList(List=panel_3, Index="1")  # -> ListA, ListB
panel_4 = Panel(split.ListA)

# ----
panel_5 = Panel(mat.AdjacencyMatrix)
panel_6 = Panel(mat.EdgeInfo)
panel_7 = Panel(mat.NodeInfo)
matrix = DisplayMatrix(mat.AdjacencyMatrix, Digits=0)
data = Data(mat.EdgeInfo)
path = FilePath("C:\Users\silvi\Downloads\JSON exporter test-20240108T144919Z-001\JSON exporter test\output.csv")

# ---- group: CSV exporter
python_3 = GhPythonScript(datastream=data, path=path)  # -> out, a; inputs datastream: list
# ---------- python_3: Python ----------
import csv
data = datastream
csv_file_path = path
with open(csv_file_path, 'w') as csv_file:
  csv_file.write(",".join(["ID", "Label", "Source", "Target"]) + "\n")
  for row_tuple in data[1:]:
    print("Current row:", row_tuple)
    csv_file.write(row_tuple + "\n")
# ---------- end python_3 ----------

# ----
rejsonkv = SerializeKeysAndValues(Key=split.ListA, Value=split.ListB)
panel_8 = Panel(rejsonkv)
